# Grasshopper definition voronoi.gh (Grasshopper 1.0.7)

number_slider = Slider(0.5, range=0..1)
rectangle = Rectangle(Plane=PlaneXY(0, 0, 0), XSize=number_slider, YSize=number_slider, Radius=0)  # -> Rectangle, Length
edges = BrepEdges(Brep=rectangle.Rectangle)  # -> Naked, Interior, NonManifold
pop2d = Populate2D(Region=rectangle.Rectangle, Count=Slider(10, range=0..50), Seed=Slider(3, range=0..10))
fake_voronoi_2d = GhPythonScript(frame=rectangle.Rectangle, points=pop2d)  # -> out, sites, diagram; inputs frame: Curve, points: list of Point3d
# ---------- fake_voronoi_2d: Python ----------
import rhinoscriptsyntax as rs
import Rhino.Geometry as rg
from scriptcontext import doc
import random

sites = []
steps = 199



frameLines = rg.Curve.DuplicateSegments(frame)
frameLineLen = []
for line in frameLines:
    frameLineLen.append(rg.Curve.GetLength(line))
frameMax = max(frameLineLen)


for i in range(len(points)):
    site = rg.Circle(points[i], 0.002).ToNurbsCurve()
    breps = rg.Brep.CreatePlanarBreps(site)
    if breps: 
        brep = breps[0]
        sites.append(brep)



row1 = rs.DivideCurve(frameLines[0], steps, True, True)
move_vecs = []

for i in range(steps):
    pt1, pt2 = rs.AddPoint(0,0,0), rs.AddPoint(0,(frameMax/steps)*i+(frameMax/steps),0)
    move_vecs.append(rs.VectorCreate(pt2, pt1))

pts = []

for i in range(steps):
    row = rs.CopyObjects(row1, move_vecs[i])
    for point in row:
        pts.append(point)

pts = pts + row1

regions = [[] for _ in range(len(points))]

for i in range(len(pts)):
    clst_pt = rs.PointArrayClosestPoint(points, pts[i])
    regions[clst_pt].append(pts[i])

diagram = []

for i in range(len(regions)):
    reg_m = rg.Mesh.CreateFromTessellation(rs.coerce3dpointlist(regions[i]), 
                                           None, 
                                           rg.Plane.WorldXY, 
                                           False)
    diagram.append(reg_m)
# ---------- end fake_voronoi_2d ----------
voronoi_2d = GhPythonScript(frame=rectangle.Rectangle, points=pop2d)  # -> out, sites, lines; inputs frame: Curve, points: list of Point3d; disabled
# ---------- voronoi_2d: Python ----------
import rhinoscriptsyntax as rs
import Rhino.Geometry as rg

sites = []

diagram = []

for i in range(len(points)):
    site = rg.Circle(points[i], 0.005).ToNurbsCurve()
    breps = rg.Brep.CreatePlanarBreps(site)
    if breps: 
        brep = breps[0]
        sites.append(brep)

circles = []

for point1 in points:
    for point2 in points:
        for point3 in points:
            if point1 == point2:
                pass
            elif point1 == point3:
                pass
            elif point2 == point3:
                pass
            else:
                circles.append(rs.AddCircle3Pt(point1, point2, point3))

cirXY = []
cirRad = []

for circle in circles:
    cirXY.append(rs.CircleCenterPoint(circle))
    cirRad.append(rs.CircleRadius(circle))

delCir = []
delCirXY = []

for i in range(len(circles)):
    inside = 0
    for point in points:
        if (point[0] - cirXY[i][0])**2 + (point[1] - cirXY[i][1])**2 < cirRad[i]**2:
            inside += 1
    if inside == 0:
        delCir.append(circles[i])
        delCirXY.append(cirXY[i])

delCirXY = rs.CullDuplicatePoints(delCirXY)

lines = []
for i in range(len(delCirXY)):
    popped = delCirXY.pop(i)
    delCirXY.insert(i, rg.Point3d(9999,9999,9999))
    clst_pt = rs.PointArrayClosestPoint(delCirXY, popped)
    lines.append(rg.Line(popped, delCirXY[clst_pt]))
    delCirXY[i] = popped

    


#for i in range(len(delCirXY)):
    #diagram.append(rs.AddLine(delCirXY[i], delCirXY[rs.PointArrayClosestPoint(delCirXY, delCirXY[i])]))
# ---------- end voronoi_2d ----------
